# Dynamo graph Railing.dyn (Dynamo 0.7.2.2921)

railing_length_front = DoubleSlider(10.973, range=0..100)
panels_gap = DoubleSlider(0.1, range=0..0.5)
panels_count_front = IntegerSlider(9, range=0..100)
railing_height = DoubleSlider(1.067, range=0..2)
railing_panel_thickness = DoubleSlider(0.01, range=0..1)
railing_length_side = DoubleSlider(3.048, range=0..100)
panels_count_side = IntegerSlider(3, range=0..100)
panels = CodeBlock(RailingLengthFront=railing_length_front, PanelsGap=panels_gap, PanelsCountFront=panels_count_front, RailingHeight=railing_height, RailingPanelThickness=railing_panel_thickness, RailingLengthSide=railing_length_side, PanelsCountSide=panels_count_side)
# ---------- panels.designscript (75 lines) ----------
//Logo
Logo1=PolyCurve.ByJoinedCurves({Line.ByStartPointEndPoint(Point.ByCoordinates(0,0,0),Point.ByCoordinates(0,0,1.25)),Line.ByStartPointEndPoint(Point.ByCoordinates(0,0,0),Point.ByCoordinates(1,0,0)),Line.ByStartPointEndPoint(Point.ByCoordinates(1,0,0),Point.ByCoordinates(1,0,-0.25)),Arc.ByCenterPointStartPointEndPoint(Point.ByCoordinates(0,0,-0.25),Point.ByCoordinates(1,0,-0.25),Point.ByCoordinates(0,0,-1.25)),Line.ByStartPointEndPoint(Point.ByCoordinates(0,0,-1.25),Point.ByCoordinates(0,0,-0.25)),Arc.ByCenterPointStartPointEndPoint(Point.ByCoordinates(0,0,0.25),Point.ByCoordinates(0,0,1.25),Point.ByCoordinates(1,0,0.25))});
Logo1=PolyCurve.ByThickeningCurve(Logo1,0.2,Vector.YAxis());
Logo1=Surface.ByPatch(Logo1);
Logo1=Logo1.Scale(0.02);
Logo1=Logo1.Thicken(0.1,1);
Logo2=Logo1.Transform(CoordinateSystem.Identity(),CoordinateSystem.ByOrigin(Point.ByCylindricalCoordinates(CoordinateSystem.ByPlane(Plane.XZ()),(0..360..#14)<1>,0,{0.125,0.2,0.3,0.5}<2>)));
Logo3=Logo1.Transform(CoordinateSystem.Identity(),CoordinateSystem.ByOrigin(Point.ByCylindricalCoordinates(CoordinateSystem.ByPlane(Plane.XZ()),(0..360..#11)<1>,0,{0.075,0.15,0.25,0.425}<2>)));
Logof=Flatten({Logo1,Logo2,Logo3});
Logofs=List.Shuffle(Logof);
Logols=Logofs.Rotate(Plane.XY(),-90);
Logors=Logofs.Rotate(Plane.XY(),90);

//Railing Front Panels
PanelWidthFront=(RailingLengthFront-(PanelsGap*PanelsCountFront))/PanelsCountFront;
PanelX=(0+PanelsGap)..(RailingLengthFront-PanelWidthFront-PanelsGap)..#PanelsCountFront;
PanelPointsX=Point.ByCoordinates(PanelX,0,0);
PanelLine=Line.ByStartPointDirectionLength(PanelPointsX,Vector.XAxis(),PanelWidthFront);
PanelSurface=PanelLine.Extrude(Vector.ZAxis(),RailingHeight);
PanelSolid=PanelSurface.Thicken(RailingPanelThickness,true);
PanelCentroid=PanelSolid.Centroid();
//Randomization
rfp1=(Math.RandomList(PanelsCountFront)*PanelWidthFront/3)*Math.Random(-1,1.5);
rfp2=(Math.RandomList(PanelsCountFront)*RailingHeight/3)*Math.Random(-1.5,1.5);
afp=(PanelCentroid.X)+rfp1;
bfp=(PanelCentroid.Z)+rfp2;
PanelCen=Point.ByCoordinates(afp<1>,0,bfp<1>);

Clusterf=Logofs<1>.Transform(CoordinateSystem.Identity(),CoordinateSystem.ByOrigin(PanelCen)<2>);
Clusterfs1=List.Shuffle(Clusterf);
Clusterfs=List.TakeEveryNthItem(Clusterfs1,2);
Panelfs=(Solid.ByUnion(PanelSolid)).Difference(Solid.ByUnion(Flatten(Clusterfs)));

//Railing Left Side Panels;
PanelWidthSide=(RailingLengthSide-(PanelsGap*PanelsCountSide))/PanelsCountSide;
PanelY=(0+PanelsGap)..(RailingLengthSide-PanelWidthSide-PanelsGap)..#PanelsCountSide;
PanelPointsY1=Point.ByCoordinates(0,PanelY,0);
PanelLine1=Line.ByStartPointDirectionLength(PanelPointsY1,Vector.YAxis(),PanelWidthSide);
PanelSurface1=PanelLine1.Extrude(Vector.ZAxis(),RailingHeight);
PanelSolid1=PanelSurface1.Thicken(RailingPanelThickness,true);
PanelCentroid1=PanelSolid1.Centroid();
//Randomization
rlp1=(Math.RandomList(PanelsCountSide)*PanelWidthSide/3)*Math.Random(-1,1.5);
rlp2=(Math.RandomList(PanelsCountSide)*RailingHeight/3)*Math.Random(-1.5,1.5);
alp=(PanelCentroid1.Y)+rlp1;
blp=(PanelCentroid1.Z)+rlp2;
PanelCen1=Point.ByCoordinates(0,alp<1>,blp<1>);

Clusterl=Logols<1>.Transform(CoordinateSystem.Identity(),CoordinateSystem.ByOrigin(PanelCen1)<2>);
Clusterls=List.TakeEveryNthItem(List.Shuffle(Clusterl),2);

Panells=(Solid.ByUnion(PanelSolid1)).Difference(Solid.ByUnion(Flatten(Clusterls)));


//Railing Right Side Panels;
PanelPointsY2=Point.ByCoordinates(RailingLengthFront,PanelY,0);
PanelLine2=Line.ByStartPointDirectionLength(PanelPointsY2,Vector.YAxis(),PanelWidthSide);
PanelSurface2=PanelLine2.Extrude(Vector.ZAxis(),RailingHeight);
PanelSolid2=PanelSurface2.Thicken(RailingPanelThickness,true);
PanelCentroid2=PanelSolid2.Centroid();
//Randomization
rrp1=(Math.RandomList(PanelsCountSide)*PanelWidthSide/3)*Math.Random(-1,1.5);
rrp2=(Math.RandomList(PanelsCountSide)*RailingHeight/3)*Math.Random(-1.5,1.5);
arp=(PanelCentroid2.Y)+rrp1;
brp=(PanelCentroid2.Z)+rrp2;
PanelCen2=Point.ByCoordinates(RailingLengthFront,arp<1>,brp<1>);

Clusterr=Logors<1>.Transform(CoordinateSystem.Identity(),CoordinateSystem.ByOrigin(PanelCen2)<2>);
Clusterrs=List.TakeEveryNthItem(List.Shuffle(Clusterr),2);

Panelrs=(Solid.ByUnion(PanelSolid2)).Difference(Solid.ByUnion(Flatten(Clusterrs)));


//Railings Combined
Railing=Flatten({Panells,Panelfs,Panelrs});
# ----------------------------------------
code_block = CodeBlock(Railing=panels.out51) { Railing; }
byGeometries = ImportInstance.ByGeometries(code_block)
